vi "index.gviweb"   [G Web Development Software 22.3.0]
panel controls:
  "Exit (development only)": bool
  "Execution Sequence": T1[]
  "Data Grid": cluster{"Waveform": i32, "Duration": f64}[]
  "Power Button": bool
  "Abort": bool
  "Step Status": f64[]
  "Test Start": bool
  "Cancel": bool
panel indicators:
  "Test Record": cluster{"Number": f64, "Pass": bool}[]
  "Linear Progress Bar": f64
  "Total Duration": f64
  "Output": f64
  "Initialization": f64
  "Teardown": f64
  "Test History": f64[]
  "manager": error
  "ui": error
  "Program Log": string
  "dev status": string
  "Status": string
  "Initialized": bool
  "Finalized": bool
types:
  T1 = cluster{"Waveform": enum{"Flat", "Square", "Sawtooth", "Sinusoid"}, "Duration (s)": f64, "Fault Probability (%)": f64}
  "Manager State.gtype" = enum{"Idle", "Initialize", "Execute", "Finalize"}
  "Message Queue Names.gtype" = enum{"Manager", "UI", "IO"}
  "Step Data.gtype" = cluster{"Message Queue": "Message Queue Names.gtype", "Action": string}
  "Sequence.gtype" = cluster{"Manager State": "Manager State.gtype", "Steps": "Step Data.gtype"[]}
  "Manager Data.gtype" = cluster{"Current State": "Manager State.gtype", "Current Step": "Step Data.gtype", "Remaining Steps": "Step Data.gtype"[], "Remaining Sequences": "Sequence.gtype"[]}
uses:
  WebApp::support::Message Queue::Create All Message Queues.gvi
  WebApp::support::Message Queue::Dequeue Message.gvi
  WebApp::support::Message Queue::Enqueue Message (Single).gvi
  WebApp::Apped Log Text.gviweb
  WebApp::Handle Next Sequence.gviweb
  WebApp::Handle Next Step.gviweb
  NI::G Core::Error::Build Error Cluster.gvi
  WebApp::Send Sequence Complete UI Updates.gviweb
  WebApp::support::Error Handler - Message Handling Loop.gvi
  WebApp::support::Error Handler - Event Handling Loop.gvi
diagram:
  # #debug
  Property Node(instance in=reference to "dev status", "Value"="") -> (error out=w1)
  w2 = bool FALSE  # Stop Event
  Create User Event[EventName="Stop Event"](error in=w1, user event data type=w2) -> (error out=w3, user event out=w4)
  w5 = [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]  # Program Sequences
  # Make list of messages for easy screening
  for {
    w6 = each element of w5
    Property Node(instance in=w6) -> ("Init Info:Start Message"=w8)
    append w8 to w7
  }
  # Idle
  #
  # Start Pressed
  #
  # Initializaing
  # 	>> To IO ---Initialize
  # 	Waiting on UI
  # 	>> To UI ---Initialize
  # 	Waiting on IO
  # Executing
  # 	>> To IO ---Execute
  # 	Waiting on IO
  # Finalizing
  # 	>> To IO ---Finalize
  # 	Waiting on IO
  # 	>> To UI ---Finalize
  # 	Waiting on UI
  # Completed
  Build Array("Manager", "UI") -> w9
  Array Size(array=w9) -> (size(s)=w10)
  call "Create All Message Queues.gvi"(Loop Count=w10, error in=w3) -> (Message Queues=w11, error out=w12)
  Array Index(array=w11) -> (out0["Manager"]=w13, out1["UI"]=w14)
  s1 = uninitialised  # shift register
  while {
    call "Dequeue Message.gvi"(message queue in=w13, error in=w12) -> (message queue out=w15, message=w16, message data=w17, error out=w18)
    # Manager Loop
    # w4: Stop Event
    case (w16) ignore case {  # Message Cases
      frame "SW Init" {
        w19 = w18
        w20 = default
        w21 = "Manager Data.gtype" {all zero or empty}
      }
      frame "Execute Test" {
        # #CodeNeeded - Perform whatever actions correspond to the "Something Else" message.
        # Send string to "Update Display" message
        call "Enqueue Message (Single).gvi"(message queue in=w15, message="Update Display", message data="\"Do Something Else\" button pressed", error in=w18) -> (error out=w19)
        w20 = default
        w21 = s1
      }
      frame "Error" {
        # #CodeRecommended - Consider creating a system for logging errors in some way. These errors are for notification purposes only. Handling of specific errors should be performed in the message frames that generated the error.
        Variant To Data(error in (no error)=w18, type=no error, variant=w17) -> (data=w22, error out=w19)
        # #CodeRecommended - If you ever change the name of this "Error" message, you'll need to update the name in the Check Loop Error.vi as well.
        $manager <- w22
        w20 = default
        w21 = s1
      }
      frame "---Copy This Frame---" {
        Merge Errors(w18) -> (error out=w19)
        w20 = default
        w21 = s1
      }
      frame "Exit Pressed" {
        s2 = w18  # shift register
        for {
          w23 = each element of w11
          call "Enqueue Message (Single).gvi"(message queue in=w23, message="Exit", error in=s2) -> (error out=w24)
          next s2 = w24
        }
        Merge Errors(s2) -> (error out=w19)
        w20 = default
        w21 = s1
      }
      frame "Exit" {
        Generate User Event(event data=TRUE, user event=w4) -> (error out=w25)
        Release Queue(queue=w15) -> (error out=w26)
        Merge Errors(w26, w25) -> (error out=w19)
        w20 = TRUE
        w21 = s1
      }
      frame Default {
        Search 1D Array(1D array=w7, element=w16) -> (index of element=w27)
        case (w27) {
          frame Default {
            Property Node(instance in=s1) -> ("Current State"=w28, instance out=w29)
            Array Index(array=w5) -> (out0[w27]=w30)
            Property Node(instance in=w30) -> ("Init Info:Valid Starts"=w31, instance out=w32)
            Search 1D Array(1D array=w31, element=w28) -> (index of element=w33)
            # Message in sequence start list -> ensure in valid start state
            case (w33) {
              frame Default {
                call "Apped Log Text.gviweb"(Input=w11, resulting string="******************\nStart", error out=w18) -> (Output_2=w34)
                Property Node(instance in=w32) -> ("Sequences"=w35)
                # In valid state for recieved message -> react
                call "Handle Next Sequence.gviweb"(manager data in=w29, Sequences=w35, error in=w34, Message Queues=w11) -> (manager data out=w36, Sequence Steps=w37, Sequences Empty=w38, error out=w39)
                case (w38) {
                  frame True {
                    w40 = "-------------------------------------\nSequences Empty\n-------------------------------------"
                    # #test
                    call "Apped Log Text.gviweb"(Input=w11, resulting string=w40, error out=w39) -> (Output_2=w19)
                    w21 = w36
                  }
                  frame False {
                    call "Handle Next Step.gviweb"(message queues=w11, manager data in=w36, Sequence Steps=w37, Input=w39) -> (manager data out=w21, Output=w19)
                  }
                }
              }
              frame -1 {
                w41 = """-------------------------------------
Received inavalid message for current status

Invalid Message: %s

State: %s
Currently waiting on: %s
-------------------------------------"""
                Property Node(instance in=w29) -> ("Current State"=w42, "Current Step:Message Queue"=w43)
                Format Into String(formatString=w41, errIn=w18, w42, w43, w16) -> (outString=w44, errOut=w45)
                call "Apped Log Text.gviweb"(Input=w11, resulting string=w44, error out=w45) -> (Output_2=w19)
                w21 = w29
              }
            }
          }
          frame -1 {
            # Message missing from sequence start list
            w46 = "The invalid message string \"%s\" was received in the Message Handling Loop."
            # Message undefined
            Format Into String(formatString=w46, w16) -> w47
            call "Build Error Cluster.gvi"(code=1, description=w47, error in=w18) -> (error out=w19)
            w21 = s1
          }
        }
        w20 = default
      }
      frame "Step Complete" {
        Property Node(instance in=s1) -> ("Current Step"=w48)
        Variant To Data(error in (no error)=w18, type=w48, variant=w17) -> (data=w49, error out=w50)
        Is Equal[ComparisonMode=CompareAggregates](x=w48, y=w49) -> w51
        case (w51) {
          frame False, Default {
            w19 = w50
            w21 = s1
          }
          frame True {
            Property Node(instance in=s1) -> ("Remaining Steps"=w52, instance out=w53)
            Array Size(array=w52) -> (size(s)=w54)
            Property Node(instance in=w48) -> ("Message Queue"=w55, "Action"=w56)
            Format Into String(formatString="Completed %s %s", errIn=w50, w55, w56) -> (outString=w57, errOut=w58)
            call "Apped Log Text.gviweb"(Input=w11, resulting string=w57, error out=w58) -> (Output_2=w59)
            case (w54) {
              frame Default {
                call "Handle Next Step.gviweb"(message queues=w11, manager data in=w53, Sequence Steps=w52, Input=w59) -> (manager data out=w21, Output=w19)
              }
              frame 0 {
                Property Node(instance in=w53) -> ("Remaining Sequences"=w60, "Current State"=w61, instance out=w62)
                call "Handle Next Sequence.gviweb"(manager data in=w62, Sequences=w60, Message Queues=w11) -> (manager data out=w63, Sequence Steps=w64, Sequences Empty=w65)
                call "Send Sequence Complete UI Updates.gviweb"(Current State=w61, Input=w11, Error In=w59) -> (Error out=w66)
                case (w65) {
                  frame False, Default {
                    call "Handle Next Step.gviweb"(message queues=w11, manager data in=w63, Sequence Steps=w64, Input=w66) -> (manager data out=w21, Output=w19)
                  }
                  frame True {
                    # Program sequence complete
                    call "Apped Log Text.gviweb"(Input=w11, resulting string="Complete\n******************", error out=w66) -> (Output_2=w19)
                    w21 = w63
                  }
                }
              }
            }
          }
        }
        w20 = default
      }
    }
    call "Error Handler - Message Handling Loop.gvi"(message queue in=w15, error in=w19) -> (dup error in=w67)
    next s1 = w21
    stop if w20
  }
  # #todo
  # display completed status when program sequence complete
  # save all text log messages in same place
  # initialize controls
  # #Todo error handling - display in log
  Register For Events("Stop Event"=w4) -> (event registration refnum out=w68)
  # This is the Queued Message Handler design pattern. The Event Handling Loop generates messages based on user interface actions. The Message Handling Loop processes messages generated by the Event Handling Loop, or by other messages.  The messages are string values, so new messages can be added easily to the Message Cases case structure in the Message Handling Loop.  Each message cluster can also provide an optional value for Message Data, which is a variant that can be converted to whatever message-specific data is required.
  s3 = w68  # shift register
  while {
    event (dynamic events = s3) {
      on "Test Start" Value changed {
        # #CodeNeeded - Send the appropriate message for this user interface event.
        call "Enqueue Message (Single).gvi"(message queue in=w13, message="Start Pressed") -> (message queue out=w71, error out=w70)
        w69 = default
      }
      on "Exit (development only)" Value changed {
        call "Enqueue Message (Single).gvi"(priority message=TRUE, message queue in=w13, message="Exit Pressed") -> (message queue out=w71, error out=w70)
        w69 = default
      }
      on dynamic event 0 {
        # The Message Handling Loop processed an "Exit" message, which fired this event to stop the Event Handling Loop.
        w69 = TRUE
        w70 = default
        w71 = w13
      }
    }
    call "Error Handler - Event Handling Loop.gvi"(message queue in=w71, error in=w70) -> (dup error in=w72)
    stop if w69
  }
  Unregister For Events(error in=w72, event registration refnum=s3) -> (error out=w73)
  Merge Errors(w73, w67) -> (error out=w74)
  Destroy User Event(error in=w74, user event=w4)
  s4 = uninitialised  # shift register
  while {
    call "Dequeue Message.gvi"(message queue in=w14, error in=w12) -> (message queue out=w75, message=w76, message data=w77, error out=w78)
    # UI Update Loop
    case (w76) ignore case {  # Message Cases
      frame "SW Init" {
        Property Node(instance in=reference to "ui", "Value"=no error, error in=w78) -> (error out=w82, instance out=w83)
        Property Node(instance in=reference to "Initialized", "Value"=FALSE, error in=w78) -> (error out=w84, instance out=w85)
        Property Node(instance in=reference to "Status", "Value"="Idle", error in=w78) -> (error out=w86, instance out=w87)
        Property Node(instance in=reference to "Program Log", "Value"="", error in=w78) -> (error out=w88, instance out=w89)
        Build Array(w83, w85, w87, w89) -> w90
        Merge Errors(w82, w84, w86, w88) -> (error out=w91)
        s5 = w91  # shift register
        for {
          w92 = each element of w90
          Close Reference(error in=s5, reference=w92) -> (error out=w93)
          next s5 = w93
        }
        w79 = s5
        w80 = default
        w81 = ""
      }
      frame "Initialize" {
        sequence {
          frame 0 {
            # #debug
            Wait(time to wait=2000)
          }
        }
        Property Node(instance in="Step Data.gtype" {all zero or empty}, "Message Queue"="UI", "Action"=w76) -> (instance out=w94)
        call "Enqueue Message (Single).gvi"(message queue in=w13, message="Step Complete", message data=w94, error in=w78) -> (error out=w79)
        w80 = default
        w81 = s4
      }
      frame "Update Status" {
        Variant To Data(error in (no error)=w78, type=string "", variant=w77) -> (data=w95, error out=w79)
        Format Into String(formatString="%s\n%s", s4, w95) -> w81
        $"Program Log" <- w81
        w80 = default
      }
      frame "Update Program Status" {
        Variant To Data(error in (no error)=w78, type=w76, variant=w77) -> (data=w96, error out=w79)
        $Status <- w96
        w80 = default
        w81 = s4
      }
      frame "Initialize Complete" {
        $Initialized <- TRUE
        w79 = w78
        w80 = default
        w81 = s4
      }
      frame "Error" {
        Variant To Data(error in (no error)=w78, type=no error, variant=w77) -> (data=w97, error out=w79)
        # #CodeRecommended - If you ever change the name of this "Error" message, you'll need to update the name in the Check Loop Error.vi as well.
        $ui <- w97
        w80 = default
        w81 = s4
      }
      frame "---Copy This Frame---" {
        Merge Errors(w78) -> (error out=w79)
        w80 = default
        w81 = s4
      }
      frame "Exit" {
        Release Queue(queue=w75) -> (error out=w98)
        Merge Errors(w78, w98) -> (error out=w79)
        w80 = TRUE
        w81 = s4
      }
      frame Default {
        w99 = "The invalid message string \"%s\" was received in the Message Handling Loop."
        Format Into String(formatString=w99, w76) -> w100
        call "Build Error Cluster.gvi"(code=1, description=w100, error in=w78) -> (error out=w79)
        w80 = default
        w81 = s4
      }
    }
    call "Error Handler - Message Handling Loop.gvi"(message queue in=w75, error in=w79) -> (dup error in=w101)
    next s4 = w81
    stop if w80
  }
